# Dynamo custom node Python GetItemAtIndex Function.dyf (Dynamo 2.0.3.8810)
# category: Python
# We get a element at a index

list = Input(list: var[]..[])
int = Input(int: var[]..[])
python_getitematindex = Python(IN[0]=list, IN[1]=int)
# ---------- python_getitematindex.python (18 lines) ----------
#Created by Dalton Goodwin, for learning purposes. Please email me at dalton.c.goodwin@gmail or reach out on LinkedIn for any questions.
#converts a string to a number

#input a list
x=IN[0]
#input a int
y=IN[1]

#Here we create a function. The x and y in our function within the () are Arguments. I like to think of them as inputs
def GetItem(x,y):
#Here we see if the list of elements is greater then the int, if so return the index.
	if len(x) > y:
		return(x[y])
#If not here return string
	else: 
		return("index doesn't exist")		
#Output is the string as a int
OUT = GetItem(x,y)
# ----------------------------------------
