# Dynamo custom node Python abs() Function.dyf (Dynamo 2.0.3.8810)
# category: Python.Functions

double = Input(double: var[]..[])
int = Input(int: var[]..[])
complex = Input(complex: var[]..[])
python_abs_function = Python(IN[0]=double, IN[1]=int, IN[2]=complex)
# ---------- python_abs_function.python (9 lines) ----------
# Created by Dalton Goodwin, for learning purposes. Please email me at dalton.c.goodwin@gmail or reach out on LinkedIn for any questions.

#The three inputs here are a float, int, and complex value. The abs() function returns a absolute value of a number. 

float = IN[0]
int = IN[1]
complex = IN[2]

OUT = [abs(float), abs(complex), abs(int)]
# ----------------------------------------
