# Dynamo custom node Python all() Function.dyf (Dynamo 2.0.3.8810)
# category: Python.Functions

list = Input(list: var[]..[])
python_all_function = Python(IN[0]=list)
# ---------- python_all_function.python (12 lines) ----------
# Created by Dalton Goodwin, for learning purposes. Please email me at dalton.c.goodwin@gmail or reach out on LinkedIn for any questions.

# The all() Function looks at a list of bools and retruns a true if all of them are true and a false for anything else. 
x = IN[0]

def all(x):
	for element in x:
		if not element:
			return False
	return True

OUT = all(x)
# ----------------------------------------
