# Dynamo custom node Python any() Function.dyf (Dynamo 2.0.3.8810)
# category: Python.Functions

list = Input(list: var[]..[])
python_any_function = Python(IN[0]=list)
# ---------- python_any_function.python (12 lines) ----------
# Created by Dalton Goodwin, for learning purposes. Please email me at dalton.c.goodwin@gmail or reach out on LinkedIn for any questions.

# The any() funtion is like the  all() Function, ecept for needing all of them to be true to return true, you would just need one.   
x = IN[0]

def any(x):
	for element in x:
		if element:
			return True
	return False

OUT = any(x)
# ----------------------------------------
