# Dynamo custom node Python bin() Funciton.dyf (Dynamo 2.3.0.5885)
# category: Python.Functions

Int = Input(Int: int[]..[])
python_bin_function = Python(IN[0]=Int)
# ---------- python_bin_function.python (7 lines) ----------
# Created by Dalton Goodwin, for learning purposes. Please email me at dalton.c.goodwin@gmail or reach out on LinkedIn for any questions.

#This is a very simple funciton, to use. It converts a int number to a binary string prefixed with 0b
x = IN[0]


OUT = [bin(x), format(x, 'b')]
# ----------------------------------------
