# Dynamo custom node Python bool() Function.dyf (Dynamo 2.0.3.8810)
# category: Python.Functions

var = Input(var: var[]..[])
python_bool_function = Python(IN[0]=var)
# ---------- python_bool_function.python (7 lines) ----------
# Created by Dalton Goodwin, for learning purposes. Please email me at dalton.c.goodwin@gmail or reach out on LinkedIn for any questions.

#The bool() Function, will return true if the list has anything in it, input is true, if the input is 1. It will return false for empty list, false input, and 0.
x = IN[0]


OUT = bool(x)
# ----------------------------------------
