# Dynamo custom node Python bytearray() Function.dyf (Dynamo 2.0.3.8810)
# category: Python.Functions

string = Input(string: var[]..[])
bool = Input(bool: var[]..[])
int = Input(int: var[]..[])
python_bytearray_function = Python(IN[0]=string, IN[1]=bool, IN[2]=int)
# ---------- python_bytearray_function.python (20 lines) ----------
# Created by Dalton Goodwin, for learning purposes. Please email me at dalton.c.goodwin@gmail or reach out on LinkedIn for any questions.

#1st list returns a bytearray object which is an array of given bytes
#2nd list creates an array of that number size
x = IN[0]
y = IN[1]
z = IN[2]

# encoding the string with unicode 8 and 16
def utf(y):
	if y == True:
		return 'utf-8'
	return 'utf-16'
#Check to see if the input is a int, if not returns a 0, which creates a empty list. 
def utfint(z):
	if (isinstance(z, int)):
		return int(z)
	return 0

OUT =  [[bytearray(x, utf(y))], [bytearray(utfint(z))]]
# ----------------------------------------
