# Dynamo custom node Python bytes() Function.dyf (Dynamo 2.3.0.5885)
# category: Python.Functions

Int = Input(Int: int[]..[])
python_bytes_function = Python(IN[0]=Int)
# ---------- python_bytes_function.python (5 lines) ----------
# Created by Dalton Goodwin, for learning purposes. Please email me at dalton.c.goodwin@gmail or reach out on LinkedIn for any questions.

#The bytes() function returns a bytes object
x = IN[0]
OUT = bytes(x)
# ----------------------------------------
