# Dynamo custom node Python callable() Function.dyf (Dynamo 2.3.0.5885)
# category: Python.Functions

Var = Input(Var: var[]..[])
python_callable_fuction = Python(IN[0]=Var)
# ---------- python_callable_fuction.python (6 lines) ----------
# Created by Dalton Goodwin, for learning purposes. Please email me at dalton.c.goodwin@gmail or reach out on LinkedIn for any questions.

#Returns if the input is callable
x = IN[0]

OUT = (callable(x))
# ----------------------------------------
