# Dynamo custom node Python format() Function.dyf (Dynamo 2.3.0.5885)
# category: Python.Functions

# note: Use {} to indicate where the var should go.
STring = Input(STring: string[]..[])
Var = Input(Var: var[]..[])
python_format_function = Python(IN[0]=STring, IN[1]=Var)
# ---------- python_format_function.python (6 lines) ----------
# Created by Dalton Goodwin, for learning purposes. Please email me at dalton.c.goodwin@gmail or reach out on LinkedIn for any questions.

#This method lets us concatenate elements within a string through positional formatting.
x = IN[0]
y = IN[1]
OUT = (x.format(y))
# ----------------------------------------
