# Dynamo custom node Python index() Method.dyf (Dynamo 2.0.3.8810)
# category: Python
# Will return the index of a element in a list

list = Input(list: var[]..[])
int_var = Input(int: var[]..[]: var[]..[])
python_script = Python(IN[0]=list, IN[1]=int_var)
# ---------- python_script.python (7 lines) ----------
# Created by Dalton Goodwin, for learning purposes. Please email me at dalton.c.goodwin@gmail or reach out on LinkedIn for any questions.
# the index method will reture the index of that element
x = IN[0]
y = IN[1]


OUT = x.index(y)
# ----------------------------------------
