# Dynamo custom node Python len() Function.dyf (Dynamo 2.0.3.8810)
# category: Python

List_var = Input(List: var[]..[]: var[]..[])
python_len_function = Python(IN[0]=List_var)
# ---------- python_len_function.python (5 lines) ----------
# Created by Dalton Goodwin, for learning purposes. Please email me at dalton.c.goodwin@gmail or reach out on LinkedIn for any questions.
#returns a number of items in a list. You can think of this like being the Dynmao Count node
Buildings = IN[0]

OUT =len(Buildings)
# ----------------------------------------
