# Dynamo custom node Python_Dictionary.dyf (Dynamo 2.3.0.5885)
# category: Python

keys = Input(keys: var[]..[])
values = Input(values: var[]..[])
python_dictionary = Python(IN[0]=keys, IN[1]=values)
# ---------- python_dictionary.python (7 lines) ----------
keys = IN[0]
values = IN[1]


dictionary = dict(zip(keys, values))

OUT = dictionary
# ----------------------------------------
