# Dynamo custom node Python_Dictionary_GetValue.dyf (Dynamo 2.3.0.5885)
# category: Python

Dict = Input(Dict: var[]..[])
keys = Input(keys: var[]..[])
python_dictionary_get_value = Python(IN[0]=Dict, IN[1]=keys)
# ---------- python_dictionary_get_value.python (6 lines) ----------
dictionary = IN[0]
Key = IN[1]

value = dictionary[Key]

OUT = value
# ----------------------------------------
