# Dynamo custom node Python_For_Loop.dyf (Dynamo 2.3.0.5885)
# category: Python

Var = Input(Var: var[]..[])
python_script = Python(IN[0]=Var)
# ---------- python_script.python (14 lines) ----------
# Created by Dalton Goodwin, for learning purposes. Please email me at dalton.c.goodwin@gmail or reach out on LinkedIn for any questions.

#A for loop is used for iterating over a sequence
x = IN[0]

def forloop(x):
	for z in x:
		return z
		




OUT = forloop(x)
# ----------------------------------------
