# Dynamo custom node Python_GetItemAtIndex_Function.dyf (Dynamo 2.3.0.5885)
# category: Python.Functions

list = Input(list: var[]..[])
Int = Input(Int: int[]..[])
python_getitematindex_function = Python(IN[0]=list, IN[1]=Int)
# ---------- python_getitematindex_function.python (19 lines) ----------
#Created by Dalton Goodwin, for learning purposes. Please email me at dalton.c.goodwin@gmail or reach out on LinkedIn for any questions.

#returns a element at index

#input a list
x=IN[0]
#input a int
y=IN[1]

#Here we create a function. The x and y in our function within the () are Arguments. I like to think of them as inputs
def GetItem(x,y):
#Here we see if the list of elements is greater then the int, if so return the index.
    if len(x) > y:
        return(x[y])
#If not here return string
    else: 
        return("index doesn't exist")        
#Output is the string as a int
OUT = GetItem(x,y)
# ----------------------------------------
