# Dynamo custom node Python_index()_Function.dyf (Dynamo 2.3.0.5885)
# category: Python.Functions

list = Input(list: var[]..[])
Int = Input(Int: int[]..[])
python_index_function = Python(IN[0]=list, IN[1]=Int)
# ---------- python_index_function.python (8 lines) ----------
# Created by Dalton Goodwin, for learning purposes. Please email me at dalton.c.goodwin@gmail or reach out on LinkedIn for any questions.

# the index method will return the index of that element
x = IN[0]
y = IN[1]


OUT = x.index(y)
# ----------------------------------------
