# Dynamo custom node Python_len()_Function.dyf (Dynamo 2.3.0.5885)
# category: Python.Functions

list = Input(list: var[]..[])
python_len_function = Python(IN[0]=list)
# ---------- python_len_function.python (6 lines) ----------
# Created by Dalton Goodwin, for learning purposes. Please email me at dalton.c.goodwin@gmail or reach out on LinkedIn for any questions.

#returns a number of items in a list. You can think of this like being the Dynmao Count node
x = IN[0]

OUT =len(x)
# ----------------------------------------
