# Dynamo custom node Python_zip()_Function.dyf (Dynamo 2.3.0.5885)
# category: Python.Functions

Var = Input(Var: var[]..[])
Var_2 = Input(Var: var[]..[])
python_zip_function = Python(IN[0]=Var, IN[1]=Var_2)
# ---------- python_zip_function.python (6 lines) ----------
x = IN[0]
y = IN[1]

a = zip(x, y)

OUT=(list(a))
# ----------------------------------------
